# Grasshopper definition LCA2-Calculator.gh (Grasshopper 1.0.8)
# plug-ins: Human UI

pan = Panel("""Mineral building products
Insulation materials
Wood
Metals
Coverings
Plastics
Components for windows and curtain walls
Building service engineering
Others
Composites
End of Life""")
pan_2 = Panel("""Mineral building products
Insulation materials
Wood
Metals
Coverings
Plastics
Components for windows and curtain walls
Building service engineering
Others
Composites
End of Life""")
pan_3 = Panel("""Mineral building products
Insulation materials
Wood
Metals
Coverings
Plastics
Components for windows and curtain walls
Building service engineering
Others
Composites
End of Life""")
pan_4 = Panel("""Mineral building products
Insulation materials
Wood
Metals
Coverings
Plastics
Components for windows and curtain walls
Building service engineering
Others
Composites
End of Life""")
create_pulldown_menu = CreatePulldownMenu(Label="materils", ListItems=pan, showLabel=True)
value_listener = ValueListener(Elements=create_pulldown_menu, SomeProperty=True)  # -> flatten(Values), Indices
panel = Panel(value_listener.Values)
python_3_script = Python3Script(material=value_listener.Values)  # -> out, a
# ---------- python_3_script: Python ----------
if material == "Mineral building products":   
    a=["Binder","Concrete aggregates","Bricks, blocks and elements","Mortar and Concrete","Asphalt"]


if material=="Insulation materials":
    a=["Mineral wool","Rigid phenolic foam","Foam glass","Rigid phenolic foam"
,"Foam glass"
,"Expanded perlit"
,"Expanded cork"
,"Wood fibre"
,"Cellulose fibre"
,"Flax fibre"
,"Hemp"
,"Cotton"
,"Urea formaldehyde resin"
,"Melamine resin"
,"Polyethylene"
,"Rubber"
,"Thermal insulation composite system"
,"Straw"
,"Insulation elements"
,"Foamed concrete"]

if material=="Wood": 
    a=["Solid wood","Derived timber products","Wooden floor","Modified wood"]
if material=="Metals": 
    a=[
        "Steel and iron",
        "Stainless steel",
        "Aluminium",
        "Copper",
        "Zinc",
        "Lead",
        "Surface treatment and coating of metals"
    ]
if material=="Coverings": 
    a=[
        "Primer",
        "Bituminous paint",
        "Facade paint",
        "Interior covering",
        "Varnishes and stains",
        "Reactive resin"
    ]
if material=="Plastics": 
    a=[
        "Tubes",
        "Floorings",
        "Roofing membranes",
        "Profiles",
        "Elastic plastic profiles",
        "Foils and fleeces",
        "Sealing materials"
    ]
if material=="Components for windows and curtain walls": 
    a=[
        "Frames / Profiles",
        "Infill",
        "Sealing components / materials",
        "Window fittings",
        "Doors",
        "Drive systems",
        "Windows",
        "Walling",
        "Daylight systems and smoke/heat control systems",
        "Accessories for windows, walling, and doors"
    ]
if material=="Building service engineering": 
    a=[
        "Heating",
        "Air conditioning and ventilation",
        "Sanitary",
        "Electrical",
        "Conveyance",
        "Use",
        "Fire protection"
    ]
if material=="Others": 
    a=[
        "Processes at building sites",
        "Energy carrier - delivery free user",
        "Transport of goods [t km]",
        "Passenger transport [person km]",
        "9.99 (missing translation)"
    ]
if material=="Composites": 
    a=[
        "System components"
    ]
if material== "End of Life": 
    a=[
        "Generic",
        "Construction waste",
        "Consumer waste",
        "Wood",
        "Metals",
        "Plastics",
        "Building service engineering"
    ]
# ---------- end python_3_script ----------
create_pulldown_menu_2 = CreatePulldownMenu(Label=panel, ListItems=python_3_script.a, showLabel=True)
value_listener_2 = ValueListener(Elements=create_pulldown_menu_2, SomeProperty=True)  # -> flatten(Values), Indices
python_3_script_2 = Python3Script(material=value_listener_2.Values)  # -> out, a
# ---------- python_3_script_2: Python ----------
if material =="Binder":

    a=["Cement","Lime","Gypusm","Clay"]
if material=="Concrete aggregates" :
    a=["Sand and gravel","Natural stone","Pumice","Expanded clay","Expanded shale","Granulated foam glass","Perlite"
,"Byproducts from power plant"
,"Dry filling material"]
if material=="Bricks%2C blocks and elements":
    a=["Sand lime brick","Fired brick","Aerated concrete","Light concrete","Precast concrete elements and goods","Stoneware","Tiles and cladding panels"
,"Natural cut stone"
,"Slate"
,"Ceramic roof tile"
,"Concrete roof tiles"
,"Fibre Cement"
,"Gypsum plasterboard"
,"Dry screed"
,"Ceiling panel"
,"Glass block"
,"Air-dried brick (adobe)"
,"Artificial stone"]


if material=="Mortar and Concrete":
     a=["Ready mixed concrete"
 ,"Mortar (masonry)"
 ,"Screed dry mortar"
 ,"Renders and plasters"
 ,"Adhesive and adhesive mortar"
 ,"Concrete additive"]


if material=="Asphalt":
    a=["Split mastic asphalt"
,"Mastic asphalt"
,"Asphalt binder"
,"Base courses"]
#insulation
if material=="Mineral wool":
    a=["Mineral wool","Rock wool"]
if material=="Rigid phenolic foam": 
    a=["Phenolic foam boards"]
if material=="Foam glass": 
    a=["Panels"],
if material=="Expanded perlite": 
    a=["Panels"],
if material=="Wood fibre": 
    a=[
        "Wood fibre insulation boards",
        "Wood fibre and wood chips, loose"]
if material=="Cellulose fibre": 
    a=[
            "Cellulose insulation (loose fill)",
            "Cellulose insulation (panels)"
        ]
if material=="Flax fibre": 
    a=["Flax fibre mat"],
if material=="Hemp": 
    a=["Hemp fibre mat"],
if material=="Cotton": 
    a=["Conventional cotton", "Organic cotton"]
if material=="Urea formaldehyde resin": 
    a=["Urea-formaldehyde foam insulation (UFFI)"]
if material=="Melamine resin": 
    a=["Melamine foam"]
if material=="Polyethylene": 
    a=["Foam"],
if material=="Rubber": 
    a=["Foam"],
if material=="Thermal insulation composite system": 
    a=[
            "Thermal insulation composite system",
            "ETICS dowel"
        ]
if material=="Straw": 
    a=["Straw bale", "Straw panels"]
if material=="Insulation elements": 
    a=["Isokorb thermal breaks"]
if material=="Foamed concrete": 
    a=["Foamed concrete insulation panels"]
#wood
if material=="Solid wood": 
    a=[
            "Structural timber",
            "Solid structural timber (KVH)",
            "Duo and trio laminated beams",
            "Glue-laminated timber",
            "Glue-laminated timber board"
        ]
if material=="Wooden floor": 
    a=[
            "Laminate flooring",
            "Parquet",
            "Cork",
            "Multilayer Modular Floor Coverings"
        ]
if material=="Modified wood": 
    a=[
            "Acetylated wood",
            "Thermally modified timber"
        ]
#metal
if material=="Steel and iron": 
    a=[
            "Steel reinforcing bar",
            "Steel reinforcement mesh",
            "Structural steel profile",
            "Steel sheets",
            "Cast or forged steel and iron items",
            "Fixing material"
        ]
if material=="Stainless steel": 
    a=[
            "Stainless steel sheets",
            "Stainless steel tap water tubes",
            "Fastener"
        ]
if material=="Aluminium": 
    a=[
            "Aluminium sheets",
            "Aluminium profiles",
            "Cast aluminium",
            "Aluminium foil"
        ]
if material=="Copper": 
    a=[
            "Copper sheets",
            "Copper pipes",
            "Cast or forged copper and brass items"
        ]
if material=="Zinc": 
    a=["Zinc sheets"]
if material=="Lead": 
    a=["Lead sheets"]
if material=="Surface treatment and coating of metals": 
    a=[
            "Anodising of aluminium",
            "(Wet) varnishing of metals",
            "Powder coating"
        ] 
#covering
if material=="Primer": 
    a=[
        "Primer for paints and plasters"
    ]
if material=="Bituminous paint": 
    a=[
        "Bituminous paint"
    ]
if material=="Facade paint": 
    a=[
        "Dispersion",
        "Silicate dispersion",
        "Silicone resin"
    ]
if material=="Interior covering": 
    a=[
        "Wall and ceiling covering",
        "Interior paint",
        "Dispersion glue"
    ]
if material=="Varnishes and stains": 
    a=[
        "Varnish systems for wooden windows",
        "Varnish systems for wooden facade",
        "Parquet varnish",
        "Varnish systems for metals"
    ]
if material=="Reactive resin": 
    a=[
        "Reactive resin on epoxy basis",
        "Reaction resin on polyurethane basis",
        "Reaction resin on methacrylate basis"
    ]  
#plastic
if material=="Tubes": 
    a=[
            "Tap water tubes",
            "Sewer tube",
            "Rainwater/Grey water tubes"
        ]
if material=="Floorings": 
    a=[
            "PVC flooring",
            "Rubber flooring",
            "Linoleum flooring",
            "Textile flooring",
            "Multilayer Modular Floor Coverings"
        ]
if material=="Roofing membranes": 
    a=[
            "Bituminous sheet",
            "PVC sheet",
            "Elastomer sheet",
            "EVA sheet (Ethylene Vinyl Acetate)",
            "TPO roofing membranes",
            "ECB roofing membrane (Ethylene Copolymer Bitumen)",
            "PIB sheeting (Polyisobutylene)"
        ]
if material=="Foils and fleeces": 
    a=[
            "Secondary water-shedding membrane",
            "Vapour barriers and brakes",
            "Sealing foils",
            "Fleeces",
            "Building papers",
            "Technical textiles"
        ]
if material=="Sealing materials": 
    a=[
            "Rubber",
            "Silicone",
            "Polyurethane",
            "Bitumen",
            "PVC",
            "Acrylate",
            "Polysulphide"
        ]
#Components for windows and curtain walls
if material=="Frames / Profiles": 
    a=[]
if material=="Infill": 
    a=[
            "Transparent infill",
            "Opaque fillings"
        ]
if material=="Sealing components / materials": 
    a=[]
if material=="Window fittings": 
    a=[
            "Steel window fittings",
            "Aluminium window fittings",
            "Stainless steel window fittings",
            "Fastening materials",
            "Window handles",
            "Zinc fittings"
        ]
if material=="Doors": 
    a=[
            "Steel",
            "Aluminium",
            "Wood",
            "Plastic"
        ]
if material=="Drive system": 
    a=[
            "Electrical"
        ]
if material=="Windows": 
    a=[
            "Timber windows",
            "Metal windows",
            "Plastic windows"
        ]
if material=="Walling": 
    a=[
            "Curtain walling - stick construction",
            "Curtain walling - unitized walling",
            "Other walling"
        ]
if material=="Daylight systems and smoke/heat control systems": 
    a=[]
if material=="Accessories for windows, walling and doors": 
    a=[
            "Solar protection devices",
            "Finger protection devices",
            "Fire resistance and smoke control devices"
        ]
#"Building service engineering"
if material=="Heating": 
    a=[
            "Heat generator",
            "Heat distribution and dissipation",
            "Storage"
        ]
if material=="Air conditioning and ventilation": 
    a=[
            "Ventilation system",
            "Air conditioning/cooling machines",
            "Accessory",
            "Refrigerants"
        ]
if material=="Sanitary": 
    a=[
            "Sanitary ware",
            "Mountings",
            "Shower and bath tubs"
        ]
if material=="Electrical": 
    a=[
            "Cable",
            "Switches and sockets",
            "Lighting",
            "Batteries"
        ]
if material=="Conveyance": 
    a=[
            "Elevator",
            "Escalator"
        ],
if material=="Use": 
    a=[
            "Use ventilation and air conditioning",
            "Use lighting",
            "Use conveyor",
            "Use heat generator (EnEV)"
        ]
if material=="Fire protection": 
    a=[
            "Protection systems for cable and duct insulation"
        ]
#"Others"
if material=="Processes at building site": 
    a=[
            "Digger/digging",
            "Concreting"
        ]
if material=="Energy carrier - delivery free user": 
    a=[]
if material=="Transport of goods [t km]": 
    a=[]
if material=="Passenger transport [person km]": 
    a=[]

#"Composites"
if material=="System components": 
    a=[
            "Outer walls",
            "Inner walls",
            "Ceilings",
            "Flooring",
            "Reinforcement",
            "Roof superstructures"
        ]
    
#"End of Life": 
if material=="Generic": 
    a=[
            "Construction waste",
            "Consumer waste",
            "Wood",
            "Metals",
            "Plastics",
            "Building service engineering"
        ]
# ---------- end python_3_script_2 ----------
create_pulldown_menu_3 = CreatePulldownMenu(Label=value_listener_2.Values, ListItems=python_3_script_2.a, showLabel=True)
create_pulldown_menu_4 = CreatePulldownMenu(Label="materils", ListItems=pan_2, showLabel=True)
value_listener_3 = ValueListener(Elements=create_pulldown_menu_4, SomeProperty=True)  # -> flatten(Values), Indices
panel_2 = Panel(value_listener_3.Values)
python_3_script_3 = Python3Script(material=value_listener_3.Values)  # -> out, a; same code as python_3_script
create_pulldown_menu_5 = CreatePulldownMenu(Label=panel_2, ListItems=python_3_script_3.a, showLabel=True)
value_listener_4 = ValueListener(Elements=create_pulldown_menu_5, SomeProperty=True)  # -> flatten(Values), Indices
python_3_script_4 = Python3Script(material=value_listener_4.Values)  # -> out, a; same code as python_3_script_2
create_pulldown_menu_6 = CreatePulldownMenu(Label=value_listener_4.Values, ListItems=python_3_script_4.a, showLabel=True)
create_pulldown_menu_7 = CreatePulldownMenu(Label="materils", ListItems=pan_3, showLabel=True)
value_listener_5 = ValueListener(Elements=create_pulldown_menu_7, SomeProperty=True)  # -> flatten(Values), Indices
panel_3 = Panel(value_listener_5.Values)
python_3_script_5 = Python3Script(material=value_listener_5.Values)  # -> out, a; same code as python_3_script
create_pulldown_menu_8 = CreatePulldownMenu(Label=panel_3, ListItems=python_3_script_5.a, showLabel=True)
value_listener_6 = ValueListener(Elements=create_pulldown_menu_8, SomeProperty=True)  # -> flatten(Values), Indices
python_3_script_6 = Python3Script(material=value_listener_6.Values)  # -> out, a; same code as python_3_script_2
create_pulldown_menu_9 = CreatePulldownMenu(Label=value_listener_6.Values, ListItems=python_3_script_6.a, showLabel=True)
merge = Merge(Data1=create_pulldown_menu, Data2=create_pulldown_menu_2, Data3=create_pulldown_menu_3)  # -> flatten(Result)
merge_2 = Merge(Data1=create_pulldown_menu_4, Data2=create_pulldown_menu_5, Data3=create_pulldown_menu_6)  # -> flatten(Result)
create_rhino_pick_button = CreateRhinoPickButton(ButtonName="get geometry", Prompt="Please select geometry...", AllowMultiple=True, AllowNone=True, Type=0, ButtonStyle=0)
create_pulldown_menu_10 = CreatePulldownMenu(Label="materils", ListItems=pan_4, showLabel=True)
value_listener_7 = ValueListener(Elements=create_pulldown_menu_10, SomeProperty=True)  # -> flatten(Values), Indices
panel_4 = Panel(value_listener_7.Values)
python_3_script_7 = Python3Script(material=value_listener_7.Values)  # -> out, a; same code as python_3_script
create_pulldown_menu_11 = CreatePulldownMenu(Label=panel_4, ListItems=python_3_script_7.a, showLabel=True)
value_listener_8 = ValueListener(Elements=create_pulldown_menu_11, SomeProperty=True)  # -> flatten(Values), Indices
python_3_script_8 = Python3Script(material=value_listener_8.Values)  # -> out, a; same code as python_3_script_2
create_pulldown_menu_12 = CreatePulldownMenu(Label=value_listener_8.Values, ListItems=python_3_script_8.a, showLabel=True)
create_rhino_pick_button_2 = CreateRhinoPickButton(ButtonName="get geometry", Prompt="Please select geometry...", AllowMultiple=True, AllowNone=True, Type=0, ButtonStyle=0)
merge_3 = Merge(Data1=create_pulldown_menu_7, Data2=create_pulldown_menu_8, Data3=create_pulldown_menu_9)  # -> flatten(Result)
create_rhino_pick_button_3 = CreateRhinoPickButton(ButtonName="get geometry", Prompt="Please select geometry...", AllowMultiple=True, AllowNone=True, Type=0, ButtonStyle=0)
merge_4 = Merge(Data1=merge, Data2=create_rhino_pick_button)  # -> flatten(Result)
merge_5 = Merge(Data1=merge_2, Data2=create_rhino_pick_button_2)  # -> flatten(Result)
merge_6 = Merge(Data1=create_pulldown_menu_10, Data2=create_pulldown_menu_11, Data3=create_pulldown_menu_12)  # -> flatten(Result)
merge_7 = Merge(Data1=merge_3, Data2=create_rhino_pick_button_3)  # -> flatten(Result)
create_rhino_pick_button_4 = CreateRhinoPickButton(ButtonName="get geometry", Prompt="Please select geometry...", AllowMultiple=True, AllowNone=True, Type=0, ButtonStyle=0)
merge_8 = Merge(Data1=merge_6, Data2=create_rhino_pick_button_4)  # -> flatten(Result)
value_listener_9 = ValueListener(Elements=merge_4, SomeProperty=True)  # -> flatten(Values), Indices
value_listener_10 = ValueListener(Elements=merge_5, SomeProperty=True)  # -> flatten(Values), Indices
value_listener_11 = ValueListener(Elements=merge_7, SomeProperty=True)  # -> flatten(Values), Indices
value_listener_12 = ValueListener(Elements=merge_8, SomeProperty=True)  # -> flatten(Values), Indices
launchwin = LaunchWindow(
    Show=Toggle(True),
    Name="Material",
    Width=Slider(598, range=0..1000),
    Height=Slider(721, range=0..1000),
    ChildStatus=0,
    EnableHorizScroll=False)
panel_5 = Panel(value_listener_12.Values)
replace_text = ReplaceText(Text=value_listener_9.Values, Find=" ", Replace="%20", RecursiveReplace=False)
replace_text_2 = ReplaceText(Text=value_listener_10.Values, Find=" ", Replace="%20", RecursiveReplace=False)
replace_text_3 = ReplaceText(Text=value_listener_11.Values, Find=" ", Replace="%20", RecursiveReplace=False)
cluster = Cluster(list_2=replace_text, list=value_listener_9.Values)  # -> names, uuids, name_uuid, list_b
create_data_table = CreateDataTable(Data=cluster.name_uuid, ColumnHeadings="materials specification", AllowSorting=False, ColumnSizingMode=-1)
value_listener_13 = ValueListener(Elements=create_data_table, SomeProperty=True)  # -> flatten(Values), Indices
create_stack = CreateStack(UIElements=[merge_4, create_data_table], Horizontal=False)
text_split = TextSplit(Text=value_listener_13.Values, Separators="/")
list_item = ListItem(List=text_split, Index=1, Wrap=True)
cluster_2 = Cluster_2(materials_uuid=list_item)  # -> a1_a3, c1, c2, c3, c4, D, unite
cluster_3 = Cluster(list_2=replace_text_2, list=value_listener_10.Values)  # -> names, uuids, name_uuid, list_b
create_data_table_2 = CreateDataTable(Data=cluster_3.name_uuid, ColumnHeadings="materials specification", AllowSorting=False, ColumnSizingMode=-1)
value_listener_14 = ValueListener(Elements=create_data_table_2, SomeProperty=True)  # -> flatten(Values), Indices
create_stack_2 = CreateStack(UIElements=[merge_5, create_data_table_2], Horizontal=False)
text_split_2 = TextSplit(Text=value_listener_14.Values, Separators="/")
list_item_2 = ListItem(List=text_split_2, Index=1, Wrap=True)
cluster_4 = Cluster_2(materials_uuid=list_item_2)  # -> a1_a3, c1, c2, c3, c4, D, unite
replace_text_4 = ReplaceText(Text=value_listener_12.Values, Find=" ", Replace="%20", RecursiveReplace=False)
geometry = Geometry(cluster_3.list_b)
cluster_5 = Cluster(list_2=replace_text_3, list=value_listener_11.Values)  # -> names, uuids, name_uuid, list_b
create_data_table_3 = CreateDataTable(Data=cluster_5.name_uuid, ColumnHeadings="materials specification", AllowSorting=False, ColumnSizingMode=-1)
value_listener_15 = ValueListener(Elements=create_data_table_3, SomeProperty=True)  # -> flatten(Values), Indices
create_stack_3 = CreateStack(UIElements=[merge_7, create_data_table_3], Horizontal=False)
text_split_3 = TextSplit(Text=value_listener_15.Values, Separators="/")
list_item_3 = ListItem(List=text_split_3, Index=1, Wrap=True)
cluster_6 = Cluster_2(materials_uuid=list_item_3)  # -> a1_a3, c1, c2, c3, c4, D, unite
geometry_2 = Geometry(cluster.list_b)
geometry_3 = Geometry(cluster_5.list_b)
cluster_7 = Cluster(list_2=replace_text_4, list=value_listener_12.Values)  # -> names, uuids, name_uuid, list_b
create_data_table_4 = CreateDataTable(Data=cluster_7.name_uuid, ColumnHeadings="materials specification", AllowSorting=False, ColumnSizingMode=-1)
value_listener_16 = ValueListener(Elements=create_data_table_4, SomeProperty=True)  # -> flatten(Values), Indices
create_stack_4 = CreateStack(UIElements=[merge_8, create_data_table_4], Horizontal=False)
text_split_4 = TextSplit(Text=value_listener_16.Values, Separators="/")
tabbed_view = TabbedView(
    TabNames=["first material", "second material", "third material", "fourth material"],
    Tab0=flatten(create_stack_4),
    Tab1=flatten(create_stack),
    Tab2=flatten(create_stack_2),
    Tab3=flatten(create_stack_3))
list_item_4 = ListItem(List=text_split_4, Index=1, Wrap=True)
addelems = AddElements(Window=launchwin, Elements=flatten(tabbed_view), DoVLChecking=True)  # -> AddedElements, ElementNames
cluster_8 = Cluster_2(materials_uuid=list_item_4)  # -> a1_a3, c1, c2, c3, c4, D, unite
geometry_4 = Geometry(cluster_7.list_b)
python_3_script_9 = Python3Script(unite=cluster_6.unite, Geometry=geometry_3, value=cluster_6.a1_a3)  # -> out, outCome_List; inputs unite: list, Geometry: list, value: Double
# ---------- python_3_script_9: Python ----------
import rhinoscriptsyntax as rs
unite=unite[0]
outCome_List=[]
if unite=="Volumen" or unite=="Masse":
    for i in Geometry:
        volume,point=rs.SurfaceVolume(i)
        
        outCome=value*volume
        outCome_List.append(outCome)

if unite=="Fläche":
    for i in Geometry:
        Area,pt=rs.SurfaceArea(i)
        outCome=value*Area
        outCome_List.append(outCome)
# ---------- end python_3_script_9 ----------
python_3_script_10 = Python3Script(unite=cluster_4.unite, Geometry=geometry, value=cluster_4.a1_a3)  # -> out, outCome_List; inputs unite: list, Geometry: list, value: Double; same code as python_3_script_9
python_3_script_11 = Python3Script(unite=cluster_2.unite, Geometry=geometry_2, value=cluster_2.a1_a3)  # -> out, outCome_List; inputs unite: list, Geometry: list, value: Double
# ---------- python_3_script_11: Python ----------
import rhinoscriptsyntax as rs
unite=unite[0]
outCome_List=[]
if unite=="Volumen" or unite=="Masse":
    for i in Geometry:
        volume,point=rs.SurfaceVolume(i)
        print(volume)
        outCome=value*volume
        outCome_List.append(outCome)

if unite=="Fläche":
    for i in Geometry:
        Area,pt=rs.SurfaceArea(i)
        outCome=value*Area
        outCome_List.append(outCome)
# ---------- end python_3_script_11 ----------
python_3_script_12 = Python3Script(unite=cluster_8.unite, Geometry=geometry_4, value=cluster_8.a1_a3)  # -> out, outCome_List; inputs unite: list, Geometry: list, value: Double; same code as python_3_script_9
panel_6 = Panel(cluster_2.unite)
panel_7 = Panel(cluster_2.a1_a3)
panel_8 = Panel(cluster.names)
panel_9 = Panel(cluster.uuids)
panel_10 = Panel(cluster.name_uuid)
panel_11 = Panel(python_3_script_11.outCome_List)
panel_12 = Panel(cluster_4.unite)
panel_13 = Panel(cluster_4.a1_a3)
panel_14 = Panel(cluster_3.name_uuid)
panel_15 = Panel(cluster_3.names)
panel_16 = Panel(cluster_3.uuids)
panel_17 = Panel(python_3_script_10.outCome_List)
panel_18 = Panel(cluster_6.unite)
panel_19 = Panel(python_3_script_9.outCome_List)
panel_20 = Panel(cluster_6.a1_a3)
panel_21 = Panel(cluster_5.name_uuid)
panel_22 = Panel(cluster_5.names)
panel_23 = Panel(cluster_5.uuids)
panel_24 = Panel(cluster_8.unite)
panel_25 = Panel(cluster_8.a1_a3)
panel_26 = Panel(cluster_7.name_uuid)
panel_27 = Panel(cluster_7.names)
panel_28 = Panel(cluster_7.uuids)
panel_29 = Panel(python_3_script_12.outCome_List)
merge_9 = Merge(
    Data1=python_3_script_12.outCome_List,
    Data2=python_3_script_11.outCome_List,
    Data3=python_3_script_10.outCome_List,
    Data4=python_3_script_10.outCome_List)
bounds = Bounds(Numbers=merge_9)
deconstruct_domain = DeconstructDomain(Domain=bounds)  # -> Start, End
gradient = Gradient(
    LowerLimit=deconstruct_domain.Start,
    UpperLimit=deconstruct_domain.End,
    Parameter=merge_9,
    stops=[0: RGB(0, 128, 0), 0.5: RGB(255, 255, 0), 1: RGB(255, 0, 0)])
custom_preview = CustomPreview(Geometry=[geometry_4, geometry_2, geometry, geometry_3], Material=gradient)

# ==== cluster Cluster
list = ClusterInput()
list_2 = ClusterInput()
split_list = SplitList(List=list, Index=Slider(3, range=0..10))  # -> ListA, ListB
list_item = ListItem(List=list_2, Index=0, Wrap=False)  # -> Item, Item1, Item2
list_b = ClusterOutput(split_list.ListB)
material = Python3Script(type=list_item.Item, subcategory=list_item.Item1, specific=list_item.Item2)  # -> out, names, uuids, Name_uuid; inputs type: String, subcategory: String, specific: String
# ---------- material: Python ----------
import requests
from pprint import pprint



# this function returns the material's LCIA results, for any material uuid found within that database and datastocks
def material_lcia(database_name, datastock_uuid ):
    resp = requests.get("https://oekobaudat.de/" + database_name + "/resource/datastocks/"+ datastock_uuid +"/processes/" + "categories/" +type_+"/" +subcategory+"/"+specific+"?format=json&lang=en")
    tree = resp.json()
    print(tree["totalCount"])
    return tree




# first of all we use this database
database_name= "OEKOBAU.DAT"

# second we use this datastock
datastock_uuid= "cd2bda71-760b-4fcc-8a0b-3877c10000a8"




# # we choose a material/process
#materials_uuid = "bdf06e12-4ed3-4f87-b935-9cbbd23a7f6d"








result_of_categories= material_lcia(database_name, datastock_uuid)
names=[]
uuids=[]
Name_uuid=[]
item_=result_of_categories["data"]
for i in range(len(item_)):
    
    eachitem=item_[i]
    classification=eachitem["name"]
    classification_UUID=eachitem["uuid"]
    names.append(classification)
    uuids.append(classification_UUID)
    Name_uuid.append((classification+" / "+classification_UUID))
pprint(names)
print(len(names))
# ---------- end material ----------
names = ClusterOutput(material.names)
uuids = ClusterOutput(material.uuids)
name_uuid = ClusterOutput(material.Name_uuid)

# ==== cluster Cluster_2
materials_uuid = ClusterInput()
python_3_script = Python3Script(materials_uuid=materials_uuid)  # -> out, A1_A3, C1, C2, C3, C4, D, unite; inputs materials_uuid: String
# ---------- python_3_script: Python ----------
import requests
from pprint import pprint



# this function returns the material's LCIA results, for any material uuid found within that database and datastocks
def material_lcia(database_name, datastock_uuid , material_uuid):
    resp = requests.get("https://oekobaudat.de/" + database_name + "/resource/datastocks/"+ datastock_uuid +"/processes/" + material_uuid  + "?format=json")
    tree = resp.json()
    LCA=tree["LCIAResults"]["LCIAResult"]
    unit=tree["exchanges"]["exchange"][0]["referenceToFlowDataSet"]["refObjectId"]
    return LCA,unit


def material_unit1(database_name, unit):
    resp = requests.get("https://oekobaudat.de/" + database_name +"/resource/flows/" + unit  + "?format=json")
    tree = resp.json()
    refid=tree["flowProperties"]["flowProperty"][0]["referenceToFlowPropertyDataSet"]["refObjectId"]
    return refid

def material_unit2(database_name, refid):
    resp = requests.get("https://oekobaudat.de/" + database_name +"/resource/flowproperties/" + refid  + "?format=json")
    tree = resp.json()
    un=tree["flowPropertiesInformation"]["dataSetInformation"]["name"][0]["value"]
    return un

# first of all we use this database
database_name= "OEKOBAU.DAT"

# second we use this datastock
datastock_uuid= "cd2bda71-760b-4fcc-8a0b-3877c10000a8"




# # we choose a material/process
#materials_uuid = "de1d54e8-8211-416b-9ff6-cebeb5123c71"





result_of_first_lcia= material_lcia(database_name, datastock_uuid, materials_uuid)

refid=material_unit1(database_name, result_of_first_lcia[1])
unite_=material_unit2(database_name, refid)
# # printing the first result of common:other epd's

#flattening
chosen_result=result_of_first_lcia[0][1]

pprint(chosen_result)
print(len(chosen_result))
ex1=chosen_result['other']
ex2=ex1['anies']
number=(len(ex2))

if number>1:
    print("yay")
    ex3=ex2[1]
    A1_A3=ex3["value"]
if number>2:
    ex4=ex2[2]
    C1=ex4["value"]
if number>3:
    ex5=ex2[3]
    C2=ex5["value"]
if number>4:
    ex6=ex2[4]
    C3=ex6["value"]
if number>5:
    ex7=ex2[5]
    C4=ex7["value"]
if number>6:
    ex8=ex2[6]
    D=ex8["value"]
# ---------- end python_3_script ----------
D = ClusterOutput(python_3_script.D)
unite = ClusterOutput(python_3_script.unite)
a1_a3 = ClusterOutput(python_3_script.A1_A3)
c4 = ClusterOutput(python_3_script.C4)
c1 = ClusterOutput(python_3_script.C1)
c2 = ClusterOutput(python_3_script.C2)
c3 = ClusterOutput(python_3_script.C3)
